# Grasshopper definition simpletest.gh (Grasshopper 1.0.7)
# plug-ins: FURobot, RobotKUKA, Format_KUKA6DoFArm

crv = Curve(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)
light_plastic_tool_head = LightPlasticToolHead(Normal=0, Usage=0)
dbsl = DivideBySegWithLength(Curve=crv, Length=Slider(100, range=0..100), Len=100)
R = KR270R2700(Tool=light_plastic_tool_head)
xy = XYPlane(Origin=dbsl)
tcp_for_spinning_kuka = TCPForRotatingKUKA(Plane=xy)  # -> flatten(Plane)

generate_nan = GenerateNaN()
num = Number(generate_nan)
panel = Panel(num)
merge = Merge(
    Data1=generate_nan,
    Data2=generate_nan,
    Data3=generate_nan,
    Data4=generate_nan,
    Data5=generate_nan,
    Data6=generate_nan,
    Data7=generate_nan)
line_instruction = LineInstruction(PLane=tcp_for_spinning_kuka, LineVel=Slider(50, range=1..200), FixedValue=merge, PTJ=False)

kuka_manipulator_offline_file_format = KUKAManipulatorOfflineFileFormat()

simulator = RobotSimulator(
    Slider=Slider(0, range=0..1),
    Robot=R,
    CMD=line_instruction,
    Format=kuka_manipulator_offline_file_format,
    Path="C:\ProgramData\test")  # -> Joint, Geo, Traj, Task, PLane
