# Grasshopper definition 2link.gh (Grasshopper 1.0.7)
# plug-ins: FURobot

construct_point = ConstructPoint(XCoordinate=Slider(900, range=0..1000), YCoordinate=0, ZCoordinate=0)

# ---- group: ConstrucRotationJoint
dom = ConstructDomain(DomainStart=Slider(-10000, range=-100000..100000), DomainEnd=Slider(10000, range=-100000..100000))
pt = ConstructPoint(
    XCoordinate=Slider(0, range=-10000..10000),
    YCoordinate=Slider(0, range=-10000..10000),
    ZCoordinate=Slider(0, range=-10000..10000))
vec = VectorXYZ(XComponent=Slider(0, range=-1..1), YComponent=Slider(0, range=-1..1), ZComponent=Slider(1, range=-1..1))  # -> Vector, Length
construcrotationjoint = ConstrucRotationJoint(Ω=vec.Vector, P=construct_point, Limit=dom)

# ----
construct_point_2 = ConstructPoint(XCoordinate=Slider(1800, range=0..10000), YCoordinate=0, ZCoordinate=0)

# ---- group: ConstrucRotationJoint
dom_2 = ConstructDomain(DomainStart=Slider(-10000, range=-100000..100000), DomainEnd=Slider(10000, range=-100000..100000))
pt_2 = ConstructPoint(
    XCoordinate=Slider(0, range=-10000..10000),
    YCoordinate=Slider(0, range=-10000..10000),
    ZCoordinate=Slider(0, range=-10000..10000))
vec_2 = VectorXYZ(XComponent=Slider(0, range=-1..1), YComponent=Slider(0, range=-1..1), ZComponent=Slider(1, range=-1..1))  # -> Vector, Length
construcrotationjoint_2 = ConstrucRotationJoint(Ω=vec_2.Vector, P=construct_point_2, Limit=dom_2)

# ----
mesh = Mesh(<mesh referenced from the Rhino model>)
mesh_2 = Mesh(<mesh referenced from the Rhino model>)
mesh_3 = Mesh(<mesh referenced from the Rhino model>)
mesh_4 = Mesh(<mesh referenced from the Rhino model>)
mesh_5 = Mesh(<mesh referenced from the Rhino model>)
colour_swatch = ColourSwatch(SwatchColor=RGB(255, 255, 255))
construct_domain = ConstructDomain(DomainStart=Slider(-180, range=-1000..-180), DomainEnd=Slider(180, range=0..1000))
colour_swatch_2 = ColourSwatch(SwatchColor=RGB(214, 214, 214))
create_rod = CreateLink(Mesh=mesh, Material=colour_swatch, Density=1000)
create_rod_2 = CreateLink(Mesh=mesh_3, Material=colour_swatch, Density=1000)
create_rod_3 = CreateLink(Mesh=mesh_2, Material=ColourSwatch(SwatchColor=RGBA(255, 89, 0, 144)), Density=1000)
create_rod_4 = CreateLink(Mesh=mesh_4, Material=ColourSwatch(SwatchColor=RGB(204, 204, 204)), Density=1000)
create_rod_5 = CreateLink(Mesh=mesh_5, Material=ColourSwatch(SwatchColor=RGB(69, 69, 69)), Density=1000)
construct_point_3 = ConstructPoint(XCoordinate=0, YCoordinate=0, ZCoordinate=0)
create_a_link_group = CreateALinkGroup(Link1=create_rod_4)
unit_z = UnitZ(Factor=1)
create_a_link_group_2 = CreateALinkGroup(Link1=create_rod)
create_a_link_group_3 = CreateALinkGroup(Link1=create_rod_3)
create_a_link_group_4 = CreateALinkGroup(Link1=create_rod_5)
create_a_link_group_5 = CreateALinkGroup(Link1=create_rod_2)
unit_z_2 = UnitZ(Factor=Slider(1000, range=0..1000))
construct_moving_joint = ConstructMovingJoint(Ν=unit_z_2, Limit=null, Limit_2=Domain(nan, nan))
mesh_6 = Mesh(<mesh referenced from the Rhino model>)
construcrotationjoint_3 = ConstrucRotationJoint(Ω=unit_z, P=construct_point_3, Limit=construct_domain)
construct_robot_link = ConstructRobotLink(Mesh=mesh_6, Mat=ColourSwatch(SwatchColor=RGB(133, 133, 133)))
number_slider = Slider(980, range=0..1000)
merge = Merge(Data1=construct_moving_joint, Data2=construcrotationjoint_3, Data3=construcrotationjoint, Data4=construcrotationjoint_2)
getmatrixfromxyzabc = GetMatrixFromXYZABC(X=0, Y=0, Z=Slider(-100, range=-100..-99), A=0, B=0, C=0)  # -> XYZABC, Matrix
number_slider_2 = Slider(1000, range=0..1000)
number_slider_3 = Slider(700, range=0..1000)
merge_2 = Merge(
    Data1=create_a_link_group_4,
    Data2=create_a_link_group,
    Data3=create_a_link_group_2,
    Data4=create_a_link_group_3,
    Data5=create_a_link_group_5)
curve = Curve(<curve referenced from the Rhino model>)
construct_point_4 = ConstructPoint(XCoordinate=Slider(1800, range=0..10000), YCoordinate=0, ZCoordinate=Slider(1000, range=0..1000))
custom_tool = CustomTool(Link=construct_robot_link, Transform=getmatrixfromxyzabc.Matrix, Normal=0, Usage=2)
merge_3 = Merge(
    Data1=Slider(200, range=0..1000),
    Data2=Slider(-70, range=-100..-70),
    Data3=Slider(60, range=0..100),
    Data4=Slider(0, range=0..100))
dividebysegwithlength = DivideBySegWithLength(Curve=curve, Length=Slider(100, range=0..100), Len=100)
xy_plane = XYPlane(Origin=construct_point_4)
xy_plane_2 = XYPlane(Origin=dividebysegwithlength)

# ---- group: Construct_X_CMD_PTP_extend_v3
generate_nan = GenerateNaN()
generate_nan_2 = GenerateNaN()
generate_nan_3 = GenerateNaN()
generate_nan_4 = GenerateNaN()
generate_nan_5 = GenerateNaN()
generate_nan_6 = GenerateNaN()
merge_4 = Merge(
    Data1=generate_nan,
    Data2=generate_nan_2,
    Data3=generate_nan_3,
    Data4=generate_nan_4,
    Data5=generate_nan_5,
    Data6=generate_nan_6)
construct_x_cmd_ptp_extend_v3 = Construct_X_CMD_PTP_extend_v3(Plane=xy_plane_2, RotJointVel=Slider(20, range=1..100), MovJointVel=Slider(100, range=1..300), FixedValue=merge_4)

# ----
line_command = LineCommand(PLane=xy_plane_2, LineVel=100)
renderplanegeo = RenderPlaneGeo(Plane=xy_plane_2, Scale=100)
create_a_serial_robot = CreateASerialRobot(Tool=custom_tool, Flange=xy_plane, Joint=merge, Link=merge_2, Root=PlaneXY(0, 0, 0))

# ---- group: line command
generate_nan_7 = GenerateNaN()
generate_nan_8 = GenerateNaN()
generate_nan_9 = GenerateNaN()
generate_nan_10 = GenerateNaN()
generate_nan_11 = GenerateNaN()
generate_nan_12 = GenerateNaN()
merge_5 = Merge(
    Data1=generate_nan_7,
    Data2=generate_nan_8,
    Data3=generate_nan_9,
    Data4=generate_nan_10,
    Data5=generate_nan_11,
    Data6=generate_nan_12)
line_command_2 = LineCommand(PLane=xy_plane_2, LineVel=Slider(50, range=1..200), FixedValue=merge_5, PTJ=False)

# ----
simulator = RobotSimulator(Slider=Slider(1, range=0..1), Robot=create_a_serial_robot, CMD=line_command_2)  # -> Joint, Geo, Traj, Task, PLane
