# Grasshopper definition 避障.gh (Grasshopper 1.0.7)
# plug-ins: RobotKUKA, FURobot

# ---- group: 初始姿态
merge = Merge(
    Data1=Slider(33.35, range=-90..90),
    Data2=Slider(-90, range=-90..90),
    Data3=Slider(117.05, range=0..1000),
    Data4=Slider(0, range=0..100),
    Data5=Slider(-68, range=-100..-68),
    Data6=Slider(0, range=-90..90))

# ----
crv = Curve(<curve referenced from the Rhino model>)
divide = DivideCurve(Curve=crv, Count=Slider(1, range=0..1), Kinks=False)  # -> Points, Tangents, Parameters

# ---- group: Joint cmd
merge_2 = Merge(
    Data1=Slider(52.81, range=-90..90),
    Data2=Slider(-88.23, range=-90..90),
    Data3=Slider(102.31, range=0..1000),
    Data4=Slider(0, range=0..100),
    Data5=Slider(-68, range=-100..-68),
    Data6=Slider(0, range=-90..90))
joint_cmd = JointCmd(Joint=merge_2, RotJointVel=Slider(20, range=1..100), MovJointVel=Slider(100, range=1..300))

# ----
rotateyaxishalfpi = RotateYAxisHalfPI(Plane=divide.Points)

# ---- group: Joint cmd
joint_cmd_2 = JointCmd(Joint=merge, RotJointVel=Slider(20, range=1..100), MovJointVel=Slider(100, range=1..300))

# ---- group: Pose to joint command
generate_nan = GenerateNaN()
generate_nan_2 = GenerateNaN()
generate_nan_3 = GenerateNaN()
generate_nan_4 = GenerateNaN()
generate_nan_5 = GenerateNaN()
generate_nan_6 = GenerateNaN()
merge_3 = Merge(
    Data1=generate_nan,
    Data2=generate_nan_2,
    Data3=generate_nan_3,
    Data4=generate_nan_4,
    Data5=generate_nan_5,
    Data6=generate_nan_6)
pose_to_joint_command = PoseToJointCommand(Plane=rotateyaxishalfpi, RotJointVel=Slider(20, range=1..100), MovJointVel=Slider(100, range=1..300), FixedValue=merge_3)

# ----
panel = Panel(merge)

light_plastic_tool_head = LightPlasticToolHead(Usage=0)
R = AgilusKR6KR10R900(Tool=light_plastic_tool_head)

merge_4 = Merge(Data1=joint_cmd_2, Data2=joint_cmd, Data3=pose_to_joint_command)
number_slider = Slider(1, range=0..1)

# ---- group: 障碍物体
mesh = Mesh(<mesh referenced from the Rhino model>)
mesh_2 = Mesh(<mesh referenced from the Rhino model>)
merge_5 = Merge(Data1=mesh_2, Data2=mesh)

# ---- group: Arm simulator
panel_2 = Panel("C:\Users\LmScr\Documents\Work\FURobotTutorialDoc\避障\避障")
light_plastic_tool = LightPlasticTool(Usage=0)
R_2 = AgilusKR6KR10R900(Tool=light_plastic_tool)
merge_6 = Merge()
arm_simulator = ArmSimulator(Slider=Slider(0, range=0..1), Robot=R, CMD=flatten(merge_4), Mesh=flatten(merge_5), TrajPreview=True)  # -> Joint, Geo, Traj, Task, PLane
